% Simulink data dictionary dic_pfc3ph.sldd

MAX_ADC = Simulink.Parameter(250, StorageClass="Const", DataType="single")
MIN_ADC = Simulink.Parameter(10, StorageClass="Const", DataType="single")
MAX_SETP = Simulink.Parameter(900, StorageClass="Const", DataType="single")
QuickStart_50025_4_6_9_7_44393 = Simulink.ConfigSet(StartTime="0", StopTime="10", Solver="FixedStepDiscrete", ProdHWDeviceType="ARM Compatible->ARM Cortex-M", SystemTargetFile="ert.tlc", TargetLang="C")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
freq = 50
phase = 3.141593
phsw_marg = 0.1
ts = 0.0001
volts = 1.533412
filter_IB = Simulink.Signal(StorageClass="ExportedGlobal", Alias="filter_IB", DataType="single")
filter_IC = Simulink.Signal(StorageClass="ExportedGlobal", Alias="filter_IC", DataType="single")
filter_IA = Simulink.Signal(StorageClass="ExportedGlobal", Alias="filter_IA", DataType="single")
QuickStart_50025_4_23_19_11_56595 = Simulink.ConfigSet(StartTime="0", StopTime="4/5", Solver="FixedStepDiscrete", ProdHWDeviceType="ARM Compatible->ARM Cortex-M", SystemTargetFile="ert.tlc", TargetLang="C")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
CONFI = Simulink.ConfigSet(StartTime="0", StopTime="3/5", Solver="FixedStepDiscrete", ProdHWDeviceType="ARM Compatible->ARM Cortex-M", SystemTargetFile="ert.tlc", TargetLang="C")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